# Grasshopper definition chain.gh (Grasshopper 1.0.7)

crv = Curve(<curve referenced from the Rhino model>)
number_slider = Slider(12, range=0..20)
pipe = Pipe(Curve=crv, Radius=Slider(1.85, range=0..10), Caps=0)
number_slider_2 = Slider(12, range=0..100)
series = Series(Start=0, Step=number_slider_2, Count=number_slider)
series_2 = Series(Start=0, Step=Slider(24.4, range=0..100), Count=Slider(6, range=0..10))
X = UnitX(Factor=series)
Y = UnitY(Factor=series_2)
graft = GraftTree(Tree=Y, IncludeEmptyLists=True, IncludeNullItems=True)
move = Move(Geometry=pipe, Motion=X)  # -> Geometry, Transform
move_2 = Move(Geometry=move.Geometry, Motion=graft)  # -> Geometry, Transform
pt = Point(Point(6.69408486, 119.541114, -57.53605049))
pt_2 = Point(Point(6.69408486, -2.938274307, 8.742817128))
pt_3 = Point(Point(6.69408486, 119.541114, 2.863871496))
pl_3pt = Plane3Pt(PointA=pt_3, PointB=pt_2, PointC=pt)
mirror = Mirror(Geometry=move_2.Geometry, Plane=pl_3pt)  # -> Geometry, Transform
multiplication = Multiplication(A=number_slider_2, B=number_slider)
addition = Addition(A=multiplication, B=Slider(2, range=-5..5))
X_2 = UnitX(Factor=addition)
move_3 = Move(Geometry=mirror.Geometry, Motion=X_2)  # -> Geometry, Transform
Y_2 = UnitY(Factor=Slider(12.2, range=0..100))
move_4 = Move(Geometry=move_3.Geometry, Motion=Y_2)  # -> Geometry, Transform
