# Grasshopper definition gyroid.gh (Grasshopper 1.0.7)
# plug-ins: Chromodoris

number_slider = Slider(10, range=0..20)
pt = Point(Point(0.03827945061, 0.06940044006, 0))
arrbox = BoxArray(
    Geometry=pt,
    Cell={Plane=PlaneXY(0.03827945061, 0.06940044006, 0), X=Domain(0, 1), Y=Domain(0, 1), Z=Domain(0, 1)},
    XCount=number_slider,
    YCount=number_slider,
    ZCount=number_slider)  # -> Geometry, Transform
pdecon = Deconstruct(Point=arrbox.Geometry)  # -> XComponent, YComponent, ZComponent
eval = Evaluate(F="sin(x) * cos(y) + sin(y) * cos(z) + sin(z) * cos(x)", x=pdecon.XComponent, y=pdecon.YComponent, z=pdecon.ZComponent)
voxelsample = SampleVoxels(
    Points=arrbox.Geometry,
    Charges=eval,
    VoxelSize=Slider(0.25, range=0..1),
    EffectiveRange=Slider(1, range=0..1),
    DensitySampling=invert(False),
    LinearSampling=True)  # -> Box, VoxelData
close = CloseVoxelData(Data=voxelsample.VoxelData)
isosurface = BuildIsoSurface(Box=voxelsample.Box, VoxelData=close, SampleValue=Slider(0, range=0..2))
smooth = QuickSmooth(Mesh=isosurface, Step=0.5, Iterations=Slider(10, range=0..10))
bbox = BoundingBox(Content=arrbox.Geometry, Plane=PlaneXY(0, 0, 0), UnionBox=True)  # -> Box, Box_2
demesh = DeconstructMesh(Mesh=smooth)  # -> Vertices, Faces, Colours, Normals
mesh = MeshBrep(
    Brep=bbox.Box,
    Settings={GridMaxCount=0, GridMinCount=16, JaggedSeams=False, MaxEdgeLength=0, MinEdgeLength=0.0001, MinTolerance=0, Refine=True, RefineAngle=0, RelativeTolerance=0.65, SimplePlanes=True, Tolerance=0})
conmesh = ConstructMesh(Vertices=demesh.Vertices, Faces=demesh.Faces)
msplit = MeshSplit(Mesh=conmesh, Splitters=mesh)
item = ListItem(List=msplit, Index=0, Wrap=True)  # -> Item1, Item
preview = CustomPreview(
    Geometry=item.Item1,
    Material={diffuse=RGB(221, 160, 221), emission=RGB(66, 48, 66), shine=0.5, specular=RGB(255, 255, 255), transparency=0})
