# Grasshopper definition organic.gh (Grasshopper 1.0.7)
# plug-ins: Kangaroo2 Components, Pufferfish, Anemone

crv = Curve(<curve referenced from the Rhino model>)
divide = DivideCurve(Curve=crv, Count=Slider(1000, range=0..1000), Kinks=False)  # -> Points, Tangents, Parameters
pline = PolyLine(Vertices=divide.Points, Closed=Toggle(True))
explode = Explode(Curve=pline, Recursive=True)  # -> Segments, Vertices
number_slider = Slider(1, range=0..10)
loop_start = LoopStart(Repeat=Slider(10, range=0..10), Trigger=Button())  # -> port, Counter, Data
len = Length(Curve=explode.Segments)
number_slider_2 = Slider(1, range=0..1)
avr = Average(Input=len)
remap = RemapNumbers(Value=loop_start.Counter, Source="0 to 10", Target="1 to 10")  # -> Mapped, Clipped
crv_2 = Curve(loop_start.Data)
multiplication = Multiplication(A=avr, B=remap.Mapped)
crv_3 = Curve(<curve referenced from the Rhino model>)
length_line = LengthLine(Line=explode.Segments, Length=multiplication, Strength=number_slider_2)
mesh = Mesh(crv_3)
sc = SphereCollide(Points=divide.Points, Radius=multiplication, Strength=number_slider_2)
onmesh = OnMesh(Points=divide.Points, Mesh=mesh, Strength=1)
stepsolver = StepSolver(
    GoalObjects=[sc, length_line, onmesh],
    Tolerance=0.0001,
    Momentum=Toggle(True),
    Damping=Slider(0.95, range=0..1),
    SubIterations=Slider(500, range=0..1000),
    Animate=Toggle(True))  # -> I, V, O
pline_2 = PolyLine(Vertices=stepsolver.V, Closed=Toggle(True))
rebcrv = RebuildCurve(Curve=pline_2, Count=Slider(2000, range=0..10000), Degree=Slider(3, range=0..10), EndTangents=Toggle(True))
merge = Merge(Data1=rebcrv, Data2=crv_2)  # -> flatten(Result)
clean = CleanTree(RemoveNulls=True, RemoveInvalid=True, RemoveEmpty=False, Tree=merge)
loop_end = LoopEnd(port=loop_start.port, Exit=False, Data=clean, TimeOutVal=0, pausedState=False, state="Constant output")
lng = ListLength(List=loop_end)
series = Series(Start=0, Step=Slider(6, range=1..10), Count=lng)
Z = UnitZ(Factor=series)
move = Move(Geometry=loop_end, Motion=Z)  # -> Geometry, Transform
loft = Loft(Curves=move.Geometry, Options={Adjust=False, Closed=False, LoftEnds=0, LoftSimp=0, LoftType=0, Rebuild=10, Refit=0.01})
cap = CapHoles(Brep=loft)
offsrf = OffsetSurface(Surface=loft, Distance=Slider(0.15, range=0..1), BothSides=False, CreateSolid=Toggle(True))
